# Grasshopper definition Wind-Flag-All-Vertices.ghx (Grasshopper 0.9.76)
# plug-ins: Kangaroo2 Components

number_slider = Slider(8, range=8..20)
pt = Point([Point(5, 0, 15), Point(19, 0, 15), Point(19, 0, 5), Point(5, 0, 5)])
rec = Rectangle({Plane=PlaneXZ(5, 0, 5), Size=Domain2(u=0..14, v=0..10)})
mplane = MeshPlane(Boundary=rec, WidthCount=Slider(12, range=10..20), HeightCount=number_slider)  # -> Mesh, Area
vec = Vector("0, 22.0, 0.5")
Z = UnitZ(Factor=1)
mesh = Mesh(mplane.Mesh)
vrot = Rotate(Vector=vec, Axis=Z, Angle=Slider(-0.01, range=-0.2..0.2))
tri = Triangulate(Mesh=mesh)  # -> Mesh, Count; disabled
item = ListItem(List=pt, Index="0", Wrap=True)  # -> Item, Item1
anchor = Anchor(Point=pt, Strength=10000)
multiplication = Multiplication(A=vrot, B=Slider(0.06, range=0..1))
number_slider_2 = Slider(50, range=0..100)
devec = DeconstructVector(Vector=item.Item1)  # -> XComponent, YComponent, ZComponent
medges = MeshEdges(Mesh=mesh)  # -> NakedEdges, InteriorEdges, NonManifoldEdges
pt_2 = ConstructPoint(XCoordinate=devec.XComponent, YCoordinate=devec.YComponent, ZCoordinate="0")
length_line = LengthLine(Line=[medges.NakedEdges, medges.InteriorEdges], Strength=10)
smooth = Smooth(M=mesh, Strength=1)
button = Button()  # disabled
toggle = BooleanToggle(False)  # disabled

# ---- group: Triangulate
number_slider_3 = Slider(0.065, range=0..1)  # disabled
pt_3 = Point([Point(5, 0, 15), Point(5, 0, 5)])  # disabled
mplane_2 = MeshPlane(Boundary={Plane=PlaneXZ(5, 0, 5), Size=Domain2(u=0..15, v=0..10)}, WidthCount=15, HeightCount=10)  # -> Mesh, Area; disabled
mesh_2 = Mesh(mplane_2.Mesh)  # disabled
panel = Panel("0")  # disabled
vec_2 = Vector(Vector(19, 17, 0))  # disabled
medges_2 = MeshEdges(Mesh=mesh_2)  # -> NakedEdges, InteriorEdges, NonManifoldEdges; disabled
multiplication_2 = Multiplication(A=vec_2, B=number_slider_3)  # disabled
tri_2 = Triangulate(Mesh=mesh_2)  # -> Mesh, Count; disabled
item_2 = ListItem(List=pt_3, Index=panel, Wrap=True)  # -> Item, Item1; disabled
vdis = VectorDisplay(Anchor=item_2.Item, Vector=vec_2)  # disabled
anchor_2 = Anchor(Point=pt_3, Strength=10000)  # disabled
panel_2 = Panel("0")  # disabled
devec_2 = DeconstructVector(Vector=item_2.Item1)  # -> XComponent, YComponent, ZComponent; disabled
medges_3 = MeshEdges(Mesh=tri_2.Mesh)  # -> NakedEdges, InteriorEdges, NonManifoldEdges; disabled
show = Show(G=mesh_2)  # disabled
pt_4 = ConstructPoint(XCoordinate=devec_2.XComponent, YCoordinate=devec_2.YComponent, ZCoordinate=panel_2)  # disabled
smooth_2 = Smooth(M=tri_2.Mesh, Strength=1)  # disabled
length_line_2 = LengthLine(Line=[medges_3.NakedEdges, medges_3.InteriorEdges], Strength=10)  # disabled
wind = Wind(Mesh=tri_2.Mesh, WindVector=multiplication_2)  # disabled
ln = Line(StartPoint=item_2.Item, EndPoint=pt_4)  # disabled
bouncysolver = BouncySolver(
    GoalObjects=[length_line_2, show, anchor_2, wind, smooth_2],
    Reset=button,
    Threshold=1e-15,
    Tolerance=0.01,
    Damping=0.99,
    Iterations=2,
    On=toggle)  # -> I, V, O; disabled
panel_3 = Panel(bouncysolver.I)  # disabled
data = Data(bouncysolver.O)  # disabled
panel_4 = Panel(bouncysolver.V)  # disabled
panel_5 = Panel(data)  # disabled

# ----
wind_2 = Wind(Mesh=mesh, WindVector=multiplication)
show_2 = Show(G=mesh)
ln_2 = Line(StartPoint=item.Item, EndPoint=pt_2)
line = Line(Line((5, 0, 15), (5, 0, 0)))
bouncysolver_2 = BouncySolver(
    GoalObjects=[length_line, show_2, anchor, wind_2, smooth],
    Reset=Button(),
    Threshold=1e-15,
    Tolerance=0.01,
    Damping=0.99,
    Iterations=2,
    On=Toggle(False))  # -> I, V, O
pipe = Pipe(Curve=line, Radius="0.1", Caps=0)
panel_6 = Panel(bouncysolver_2.I)
data_2 = Data(bouncysolver_2.O)
panel_7 = Panel(bouncysolver_2.V)
item_3 = ListItem(List=data_2, Index=0, Wrap=True)
pipeline = GeometryPipeline(
    GroupByLayer=False,
    GroupByType=False,
    IncludeHidden=True,
    IncludeLocked=True,
    LayerFilter="*",
    NameFilter="*",
    TypeFilter=4)
mesh_3 = Mesh(item_3)
addition = Addition(A=number_slider, B=1)
srf = Surface(reparameterize(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))
demesh = DeconstructMesh(Mesh=mesh_3)  # -> Vertices, Faces, Colours, Normals
crv = Curve(pipeline)
iso = IsoCurve(Surface=srf, UVPoint="0.5, 0.5")  # -> UIsocurve, VIsocurve
viewer = ParamViewer(demesh.Vertices)
ccx = CurveCurve(CurveA=iso.UIsocurve, CurveB=iso.VIsocurve)  # -> Points, ParamsA, ParamsB
yz = YZPlane(Origin=ccx.Points)
srfgrid = SurfaceFromPoints(Points=demesh.Vertices, UCount=addition, Interpolate=False)
mirror = Mirror(Geometry=crv, Plane=yz)  # -> Geometry, Transform
flip = Flip(Surface=srfgrid)  # -> Surface, Result
extr = Extrude(Base=srf, Direction="0, 0, 0.01")
srf_2 = Surface(reparameterize(flip.Surface))
geo = Geometry(mirror.Geometry)
edges = BrepEdges(Brep=srf_2)  # -> Naked, Interior, NonManifold
srfmorph = SurfaceMorph(Geometry=geo, Reference=extr, Surface=srf_2, UDomain="0 To 1", VDomain="0 To 1", WDomain="0 To 1")
panel_8 = Panel(srfmorph)
