# Grasshopper definition Wind-Flag-Right.ghx (Grasshopper 0.9.76)
# plug-ins: Python Interpreter, Kangaroo2 Components

number_slider = Slider(8, range=8..20)
pt = Point([Point(5, 0, 15), Point(5, 0, 5)])
rec = Rectangle({Plane=PlaneXZ(5, 0, 5), Size=Domain2(u=0..14, v=0..10)})
mplane = MeshPlane(Boundary=rec, WidthCount=Slider(12, range=10..20), HeightCount=number_slider)  # -> Mesh, Area
vec = Vector("0, 22.0, 0.5")
Z = UnitZ(Factor=1)
mesh = Mesh(mplane.Mesh)
vrot = Rotate(Vector=vec, Axis=Z, Angle=Slider(-0.01, range=-0.2..0.2))
tri = Triangulate(Mesh=mesh)  # -> Mesh, Count; disabled
item = ListItem(List=pt, Index="0", Wrap=True)  # -> Item, Item1
anchor = Anchor(Point=pt, Strength=10000)
multiplication = Multiplication(A=vrot, B=Slider(0.06, range=0..1))
number_slider_2 = Slider(50, range=0..100)
devec = DeconstructVector(Vector=item.Item1)  # -> XComponent, YComponent, ZComponent
medges = MeshEdges(Mesh=mesh)  # -> NakedEdges, InteriorEdges, NonManifoldEdges
pt_2 = ConstructPoint(XCoordinate=devec.XComponent, YCoordinate=devec.YComponent, ZCoordinate="0")
smooth = Smooth(M=mesh, Strength=1)
length_line = LengthLine(Line=[medges.NakedEdges, medges.InteriorEdges], Strength=10)
show = Show(G=mesh)
wind = Wind(Mesh=mesh, WindVector=multiplication)
ln = Line(StartPoint=item.Item, EndPoint=pt_2)
line = Line(Line((5, 0, 15), (5, 0, 0)))
merge = Merge(Data1=length_line, Data2=show, Data3=anchor, Data4=wind, Data5=smooth)  # -> flatten(Result)
bouncysolver = BouncySolver(GoalObjects=merge, Reset=Button(), Threshold=1e-15, Tolerance=0.01, Damping=0.99, Iterations=2, On=Toggle(False))  # -> I, V, O
pipe = Pipe(Curve=line, Radius="0.1", Caps=0)
panel = Panel(bouncysolver.I)
panel_2 = Panel(bouncysolver.V)
pipeline = GeometryPipeline(
    GroupByLayer=False,
    GroupByType=False,
    IncludeHidden=True,
    IncludeLocked=True,
    LayerFilter="*",
    NameFilter="*",
    TypeFilter=4)
crv = Curve([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])
addition = Addition(A=number_slider, B=1)
srf = Surface(reparameterize(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))
crv_2 = Curve(crv)
iso = IsoCurve(Surface=srf, UVPoint="0.5, 0.5")  # -> UIsocurve, VIsocurve
ccx = CurveCurve(CurveA=iso.UIsocurve, CurveB=iso.VIsocurve)  # -> Points, ParamsA, ParamsB
yz = YZPlane(Origin=ccx.Points)
mirror = Mirror(Geometry=crv_2, Plane=yz)  # -> Geometry, Transform
extr = Extrude(Base=srf, Direction="0, 0, 0.01")
geo = Geometry(mirror.Geometry)
panel_3 = Panel("Make2d-ExportAiFile")
number_slider_3 = Slider(203, range=0..10000)
stepsolver = StepSolver(GoalObjects=merge, Tolerance=0.01, Momentum=False, Damping=0.99, SubIterations=10, Animate=number_slider_3)  # -> I, V, O
data = Data(stepsolver.O)
item_2 = ListItem(List=data, Index=0, Wrap=True)
mesh_2 = Mesh(item_2)
demesh = DeconstructMesh(Mesh=mesh_2)  # -> Vertices, Faces, Colours, Normals
viewer = ParamViewer(demesh.Vertices)
srfgrid = SurfaceFromPoints(Points=demesh.Vertices, UCount=addition, Interpolate=False)
flip = Flip(Surface=srfgrid)  # -> Surface, Result
srf_2 = Surface(reparameterize(flip.Surface))
edges = BrepEdges(Brep=srf_2)  # -> Naked, Interior, NonManifold
srfmorph = SurfaceMorph(Geometry=geo, Reference=extr, Surface=srf_2, UDomain="0 To 1", VDomain="0 To 1", WDomain="0 To 1")
panel_4 = Panel(srfmorph)
merge_2 = Merge(Data1=srf_2)
merge_3 = Merge(Data1=srfmorph)
flatten = FlattenTree(Tree=merge_2, Path="{0}")
flatten_2 = FlattenTree(Tree=merge_3, Path="{0}")
panel_5 = Panel(flatten)
python = PythonScript(x="Flag-Right-", y=number_slider_3)  # -> out, a
# ---------- python: Python ----------
a = x + y
print a
# ---------- end python ----------
python_2 = PythonScript(path="C:\Users\yoshioca\Documents\Simulation-for-GraphicDesign\", name=python.a, Brep=flatten, Crv=flatten_2, y=Button())  # -> out, a; inputs Brep: list of Brep, Crv: list of Curve
# ---------- python_2: Python ----------
import Rhino
import rhinoscriptsyntax as rs
import scriptcontext as sc
import ghpythonlib.components as ghpc


sc.doc = Rhino.RhinoDoc.ActiveDoc


len_brep = ghpc.ListLength(Brep)
len_crv = ghpc.ListLength(Crv)

# bake_brep = []
# bake_crv = []


out_flie = path + name + ".ai"



if y == True:
    
    
    for i in xrange(len_brep):
        sel_brep = ghpc.ListItem(Brep, i)
        # print i
        # print sel_geo
        sc.doc.Objects.AddBrep(sel_brep)
        ##bake_brep.append(sel_brep)
        
        
        
    for j in xrange(len_crv):
        sel_crv = ghpc.ListItem(Crv, j)
        sc.doc.Objects.AddCurve(sel_crv)
        ##bake_crv.append(sel_crv)
        #pass
        
    
    #print bake_geos


    #sc.doc.Objects.AddBrep(bake_brep)
    #sc.doc.Objects.AddCurve(bake_crv)




    rs.CurrentView("Perspective")
    
    rs.Command('SelAll -Make2d DrawingLayout=CurrentView '
        + ' ShowTangentEdges=Yes '
        + ' CreateHiddenLines=No '
        + ' ShowViewRectangle=No '
        + ' MaintainSourceLayers=Yes _Enter ')
        
    rs.CurrentView("Top")
    
    rs.Command(' -Export ' + out_flie + ' _Enter'
        + ' SelAll Delete')
    
    rs.CurrentView("Perspective")

    print "Saved!!"

    
    #rs.Command(' _SelAll _-Export '+ str_name+ '.stl _Enter _Enter _SelAll _Delete')
    #rs.Command(' _SelAll _-Export a.ai _Enter _Ente
# ---------- end python_2 ----------
panel_6 = Panel(python_2.out)
