# Grasshopper definition Wind-Flag-Top.ghx (Grasshopper 0.9.76)
# plug-ins: Kangaroo2 Components

number_slider = Slider(8, range=8..20)
pt = Point([Point(5, 0, 15), Point(19, 0, 15)])
rec = Rectangle({Plane=PlaneXZ(5, 0, 5), Size=Domain2(u=0..14, v=0..10)})
mplane = MeshPlane(Boundary=rec, WidthCount=Slider(12, range=10..20), HeightCount=number_slider)  # -> Mesh, Area
vec = Vector("0, -12.0, 0.5")
Z = UnitZ(Factor=1)
mesh = Mesh(mplane.Mesh)
vrot = Rotate(Vector=vec, Axis=Z, Angle=Slider(-0.01, range=-0.2..0.2))
tri = Triangulate(Mesh=mesh)  # -> Mesh, Count; disabled
item = ListItem(List=pt, Index="0", Wrap=True)  # -> Item, Item1
anchor = Anchor(Point=pt, Strength=10000)
multiplication = Multiplication(A=vrot, B=Slider(0.06, range=0..1))
number_slider_2 = Slider(50, range=0..100)
devec = DeconstructVector(Vector=item.Item1)  # -> XComponent, YComponent, ZComponent
medges = MeshEdges(Mesh=mesh)  # -> NakedEdges, InteriorEdges, NonManifoldEdges
pt_2 = ConstructPoint(XCoordinate=devec.XComponent, YCoordinate=devec.YComponent, ZCoordinate="0")
length_line = LengthLine(Line=[medges.NakedEdges, medges.InteriorEdges], Strength=10)
smooth = Smooth(M=mesh, Strength=1)
wind = Wind(Mesh=mesh, WindVector=multiplication)
show = Show(G=mesh)
ln = Line(StartPoint=item.Item, EndPoint=pt_2)
line = Line(Line((5, 0, 15), (5, 0, 0)))
merge = Merge(Data1=length_line, Data2=show, Data3=wind, Data4=anchor, Data5=smooth)  # -> flatten(Result)
pipe = Pipe(Curve=line, Radius="0.1", Caps=0)
stepsolver = StepSolver(GoalObjects=merge, Tolerance=0.01, Momentum=False, Damping=0.99, SubIterations=10, Animate=Slider(22, range=0..10000))  # -> I, V, O
bouncysolver = BouncySolver(GoalObjects=merge, Reset=Button(), Threshold=1e-15, Tolerance=0.01, Damping=0.99, Iterations=2, On=Toggle(False))  # -> I, V, O
data = Data(stepsolver.O)
panel = Panel(bouncysolver.I)
item_2 = ListItem(List=data, Index=0, Wrap=True)
pipeline = GeometryPipeline(
    GroupByLayer=False,
    GroupByType=False,
    IncludeHidden=True,
    IncludeLocked=True,
    LayerFilter="*",
    NameFilter="*",
    TypeFilter=4)
mesh_2 = Mesh(item_2)
addition = Addition(A=number_slider, B=1)
srf = Surface(reparameterize(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))
demesh = DeconstructMesh(Mesh=mesh_2)  # -> Vertices, Faces, Colours, Normals
crv = Curve(pipeline)
iso = IsoCurve(Surface=srf, UVPoint="0.5, 0.5")  # -> UIsocurve, VIsocurve
viewer = ParamViewer(demesh.Vertices)
ccx = CurveCurve(CurveA=iso.UIsocurve, CurveB=iso.VIsocurve)  # -> Points, ParamsA, ParamsB
yz = YZPlane(Origin=ccx.Points)
srfgrid = SurfaceFromPoints(Points=demesh.Vertices, UCount=addition, Interpolate=False)
mirror = Mirror(Geometry=crv, Plane=yz)  # -> Geometry, Transform
flip = Flip(Surface=srfgrid)  # -> Surface, Result
extr = Extrude(Base=srf, Direction="0, 0, 0.01")
srf_2 = Surface(reparameterize(flip.Surface))
geo = Geometry(mirror.Geometry)
merge_2 = Merge()
edges = BrepEdges(Brep=srf_2)  # -> Naked, Interior, NonManifold
srfmorph = SurfaceMorph(Geometry=geo, Reference=extr, Surface=srf_2, UDomain="0 To 1", VDomain="0 To 1", WDomain="0 To 1")
panel_2 = Panel(srfmorph)
